# Grasshopper definition wire3dp.gh (Grasshopper 1.0.7)

number_slider = Slider(29, range=0..100)
square = Square(Plane=PlaneXY(0, 0, 0), Size=1, ExtentX=number_slider, ExtentY=number_slider)  # -> Cells, Points
flatten_tree = FlattenTree(Tree=square.Cells, Path="{0}")
group = Group(Objects=flatten_tree)
bounding_box = BoundingBox(Content=group, Plane=PlaneXY(0, 0, 0))  # -> Box, Box_2
curve = Curve([<curve referenced from the Rhino model> x3])
loft = Loft(Curves=curve, Options={Adjust=False, Closed=False, LoftEnds=0, LoftSimp=0, LoftType=0, Rebuild=10, Refit=0.01})
deconstruct_brep = DeconstructBrep(Brep=bounding_box.Box)  # -> Faces, Edges, Vertices
list_item = ListItem(List=deconstruct_brep.Faces, Index=0, Wrap=True)
surface = Surface(<surface referenced from the Rhino model>)
map_to_surface = MapToSurface(Curve=square.Cells, Source=list_item, Target=loft)
discontinuity = Discontinuity(Curve=map_to_surface, Level=1)  # -> Points, Parameters
